# Dynamo graph PhaseToComments.dyn (Dynamo 2.1.0.7500)

# group: Equivalent of: FilteredElementCollector
categories = Categories("OST_Walls")
all_elements_of_category = ElementsOfCategory(Category=categories)

# group: Equivalent of: LookupParameter > As Value String
code_block = CodeBlock { "Phase Created"; }
getParameterValueByName = Element.GetParameterValueByName(element=all_elements_of_category, parameterName=code_block)
name = Element.Name(element=getParameterValueByName)

# group: Equivalent of: Lookup Parameter > Set Value String
code_block_2 = CodeBlock { "Comments"; }
setParameterByName = Element.SetParameterByName(element=all_elements_of_category, parameterName=code_block_2, value=name)
